# Grasshopper definition sentiment density.gh (Grasshopper 1.0.8)
# plug-ins: Human, Heron, eleFront5

# Reading textfiles (with Grasshopper)
cluster = Cluster()
path = FilePath("D:\1group D\tearm1\venice_sentiment_coordinates.csv")
file = ReadFile(File=path, PerLineParse=True)
panel = Panel(file)
cull_i = CullIndex(List=file, Indices="0", Wrap=True)
tab = Panel(",")
split = TextSplit(Text=cull_i, Separators=tab)
panel_2 = Panel(split)
item = ListItem(List=split, Index="3", Wrap=True)  # -> Item, Item1, Item2, Item3, Item4, Item5
panel_3 = Panel(item.Item1)
panel_4 = Panel(item.Item2)
flatten_tree = FlattenTree(Tree=item.Item1, Path="{0}")
flatten_tree_2 = FlattenTree(Tree=item.Item, Path="{0}")
decimal_degrees_to_xy = DecimalDegreesToXY(Latitude=flatten_tree_2, Longitude=flatten_tree)  # -> XyPoint, Transform
geo = Geometry(<curve referenced from the Rhino model>)

# ----
# Bake with attributes (optional)
panel_5 = Panel("5")
item_2 = ListItem(List=split, Index=panel_5, Wrap=True)
tstat = TreeStatistics(Tree=item_2)  # -> Paths, Length, Count
dup = DuplicateData(Data="GSR", Number=tstat.Length, Order=True)  # -> simplify(Data)
ef_att = EleFrontAttributes(Keys=dup, Values=item_2, Layer="Points", maintainBakeName=False)  # -> flatten(Attributes), Keys, Values, Name, Layer, ColourSource, DisplayColour, MaterialSource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
bake = BakeObjects(Geometry=geo, Attributes=ef_att.Attributes, Bake=False, createGroups=False)  # -> Message, Ghosts

panel_6 = Panel(item_2)
panel_7 = Panel(dup)
multiplication = Multiplication(B=Slider(100, range=0..10000))
multiplication_2 = Multiplication(B=Slider(100, range=0..10000))
deconstruct = Deconstruct(Point=decimal_degrees_to_xy.XyPoint)  # -> XComponent, YComponent, ZComponent
pt = ConstructPoint(XCoordinate=multiplication_2, YCoordinate=multiplication, ZCoordinate=0)
construct_domain = ConstructDomain(DomainStart=Slider(0, range=0..100), DomainEnd=Slider(1000000, range=0..10000000))
panel_8 = Panel(pt)
remap_numbers = RemapNumbers(Value=item.Item2, Source=Domain(0, 1), Target=construct_domain)  # -> flatten(Mapped), Clipped
pt_2 = ConstructPoint(XCoordinate=deconstruct.XComponent, YCoordinate=deconstruct.YComponent, ZCoordinate=0)
pt_3 = ConstructPoint(XCoordinate=deconstruct.XComponent, YCoordinate=deconstruct.YComponent, ZCoordinate=remap_numbers.Mapped)
panel_9 = Panel(pt_3)
line = Line(StartPoint=pt_3, EndPoint=pt_2)

# ----
# Field values of OSM are here:
# https://wiki.openstreetmap.org/wiki/Map_features
# you can test example values here:
# https://www.openstreetmap.org/node/6429327326
# 
# The format is
# [Key],[Value]
filterfiields = Panel("natural")
path_2 = FilePath("D:\1group D\tearm2\field.trip\data\GH\map (2).osm")
# 真实地理
geo_2 = Geometry(<curve referenced from the Rhino model>)
panel_10 = Panel("addr:postcode,SE1 7ND")
panel_11 = Panel("amenity,cafe")
filterfieldvalue = Panel("natural,tree")
importosm = ImportOSM(Boundary=geo_2, OSMDataLocation=path_2, Clipped=True)  # -> Extents, Fields, Values, FeatureGeometry, Buildings

# ----
# 数值热力（不会做版
pt_4 = Point([<point referenced from the Rhino model> x5000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])
del = DelaunayMesh(Points=pt_4, Plane=PlaneXY(0, 0, 0))
contour = Contour(Shape=del, Point=Point(0, 0, 0), Direction=Vector(0, 0, 1), Distance=Slider(100, range=0..100))
number_slider = Slider(3, range=0..10)
join = JoinCurves(Curves=contour, Preserve=Slider(80, range=0..100))
eval = EvaluateCurve(Curve=join, Parameter=0)  # -> Point, Tangent, Angle
pdecon = Deconstruct(Point=eval.Point)  # -> XComponent, YComponent, ZComponent
bnd = Bounds(Numbers=flatten(pdecon.ZComponent))
dedomain = DeconstructDomain(Domain=bnd)  # -> Start, End
gradient = Gradient(
    LowerLimit=dedomain.Start,
    UpperLimit=dedomain.End,
    Parameter=flatten(pdecon.ZComponent),
    stops=[0: RGB(65, 68, 67), 0: RGB(105, 223, 228), 0: RGB(188, 178, 127), 0: RGB(234, 38, 0), 0: RGB(69, 52, 158), 0: RGB(250, 45, 234), 0: RGB(138, 115, 221), 0: RGB(31, 59, 86), 0: RGB(49, 43, 55), 0: RGB(197, 33, 239)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])
preview = CustomPreview(Geometry=flatten(contour), Material=gradient)
createatts = CreateAttributes(LayerName="Contours", Color=gradient, enableFullPath=False)
bake_2 = BakeGeometry(Bake=Button(), Geometry=flatten(contour), Attributes=createatts, DeleteOldBakes=False, PreserveTrees=False)

# ---- group: Input
geo_3 = Geometry([<point referenced from the Rhino model> x2779])
y = Panel("30")
x = Panel("50")

# ----
filterfieldvalue_2 = Panel("[Key],[Value]")

# ---- group: Inclusion
sqgrid = Square(Plane=PlaneXY(0, 0, 0), Size=1, ExtentX=x, ExtentY=y)  # -> flatten(Cells), Points
area = Area(Geometry=sqgrid.Cells)  # -> Area, Centroid
merge = Merge(Data1=geo_3, Data2=area.Centroid)
pt_5 = Point(merge)
incurves = PointInCurves(Point=pt_5, Curves=sqgrid.Cells)  # -> Relationship, Index, Point

# ---- group: Input
geo_4 = Geometry([<point referenced from the Rhino model> x100])
y_2 = Panel("30")
x_2 = Panel("50")

# ----
panel_12 = Panel(merge)

# ---- group: Inclusion
sqgrid_2 = Square(Plane=PlaneXY(0, 0, 0), Size=1, ExtentX=x_2, ExtentY=y_2)  # -> flatten(Cells), Points
area_2 = Area(Geometry=sqgrid_2.Cells)  # -> Area, Centroid
merge_2 = Merge(Data1=geo_4, Data2=area_2.Centroid)
pt_6 = Point(merge_2)
incurves_2 = PointInCurves(Point=pt_6, Curves=sqgrid_2.Cells)  # -> Relationship, Index, Point

# ----
panel_13 = Panel(merge_2)
panel_14 = Panel(area_2.Centroid)
deconstruct_2 = Deconstruct(Point=geo_4)  # -> XComponent, YComponent, ZComponent

# ---- group: Check all cells
multiplication_3 = Multiplication(A=x, B=y)
series = Series(Start=0, Step=1, Count=multiplication_3)  # -> simplify(graft(Series))
equals = Equality(FirstNumber=incurves.Index, SecondNumber=series)  # -> Equality, Inequality
cull = CullPattern(List=pt_5, CullPattern=equals.Equality)
panel_15 = Panel(cull)

# ----
# SPATIAL BINNING IN GRASSHOPPER
# How do you read the result?
# 
# The first line isn0 | 21
# and that means that Point 0 is in
# curve 21
# 
# Same is true for
# 1 | 21
# 
# And the third line is 2 | 12
# and that means that point 2
# is in curve 12.
# Add contrast by "streching" the numbers
panel_16 = Panel(pt_5)
panel_17 = Panel(incurves.Index)
tstat_2 = TreeStatistics(Tree=cull)  # -> Paths, Length, Count

# ---- group: Check one cell
equals_2 = Equality(FirstNumber=incurves.Index, SecondNumber="12")  # -> Equality, Inequality
cull_2 = CullPattern(List=pt_5, CullPattern=equals_2.Equality)
panel_18 = Panel(cull_2)

# ---- group: Check all cells
multiplication_4 = Multiplication(A=x_2, B=y_2)
series_2 = Series(Start=0, Step=1, Count=multiplication_4)  # -> simplify(graft(Series))
equals_3 = Equality(FirstNumber=incurves_2.Index, SecondNumber=series_2)  # -> Equality, Inequality
cull_3 = CullPattern(List=pt_6, CullPattern=equals_3.Equality)
panel_19 = Panel(cull_3)

# ----
# SPATIAL BINNING IN GRASSHOPPER
# Add contrast by "streching" the numbers
panel_20 = Panel(pt_6)
panel_21 = Panel(incurves_2.Index)
tstat_3 = TreeStatistics(Tree=cull_3)  # -> Paths, Length, Count

# ---- group: Check one cell
equals_4 = Equality(FirstNumber=incurves_2.Index, SecondNumber="12")  # -> Equality, Inequality
cull_4 = CullPattern(List=pt_6, CullPattern=equals_4.Equality)

# ----
dispatch = Dispatch(List=deconstruct_2.ZComponent, DispatchPattern=equals_3.Equality)  # -> ListA, ListB
panel_22 = Panel(dispatch.ListA)
average = Average(Input=dispatch.ListA)
panel_23 = Panel(average)

# ---- group: Surface Grid
bnd_2 = Bounds(Numbers=flatten(tstat_2.Length))
dom = ConstructDomain(DomainStart="0", DomainEnd="16")
remap = RemapNumbers(Value=tstat_2.Length, Source=bnd_2, Target=dom)  # -> Mapped, Clipped
Z = UnitZ(Factor=remap.Mapped)
move = Move(Geometry=area.Centroid, Motion=Z)  # -> Geometry, Transform
srfgrid = SurfaceFromPoints(Points=move.Geometry, UCount=x, Interpolate=False)

# ----
panel_24 = Panel(tstat_3.Length)
replace_nulls = ReplaceNulls(Items=panel_23, Replacements=Slider(0, range=0..100))  # -> flatten(Items), Count
panel_25 = Panel(replace_nulls.Items)

# ---- group: Surface Grid
bnd_3 = Bounds(Numbers=flatten(panel_25))
dom_2 = ConstructDomain(DomainStart="0", DomainEnd="16")
remap_2 = RemapNumbers(Value=panel_25, Source=bnd_3, Target=dom_2)  # -> Mapped, Clipped
Z_2 = UnitZ(Factor=remap_2.Mapped)
move_2 = Move(Geometry=area_2.Centroid, Motion=Z_2)  # -> Geometry, Transform
srfgrid_2 = SurfaceFromPoints(Points=move_2.Geometry, UCount=x_2, Interpolate=False)

# ----
panel_26 = Panel(Z_2)

# ---- group: Graphics & Baking
contour_2 = Contour(Shape=srfgrid, Point=Point(0, 0, 0), Direction=Vector(0, 0, 1), Distance=Slider(0.117, range=0..1))
eval_2 = EvaluateCurve(Curve=contour_2, Parameter=0)  # -> Point, Tangent, Angle
pdecon_2 = Deconstruct(Point=eval_2.Point)  # -> XComponent, YComponent, ZComponent
bnd_4 = Bounds(Numbers=flatten(pdecon_2.ZComponent))
dedomain_2 = DeconstructDomain(Domain=bnd_4)  # -> Start, End
gradient_2 = Gradient(
    LowerLimit=dedomain_2.Start,
    UpperLimit=dedomain_2.End,
    Parameter=flatten(pdecon_2.ZComponent),
    stops=[0: RGB(234, 38, 0), 0.177: RGB(234, 126, 0), 0.332: RGB(254, 244, 84), 0.871: RGB(173, 203, 249), 1: RGB(75, 107, 169)])
preview_2 = CustomPreview(Geometry=flatten(contour_2), Material=gradient_2)
createatts_2 = CreateAttributes(LayerName="Contours", Color=gradient_2, enableFullPath=False)
bake_3 = BakeGeometry(Bake=Button(), Geometry=flatten(contour_2), Attributes=createatts_2, DeleteOldBakes=False, PreserveTrees=False)

contour_3 = Contour(Shape=srfgrid_2, Point=Point(0, 0, 0), Direction=Vector(0, 0, 1), Distance=Slider(0.117, range=0..1))
eval_3 = EvaluateCurve(Curve=contour_3, Parameter=0)  # -> Point, Tangent, Angle
pdecon_3 = Deconstruct(Point=eval_3.Point)  # -> XComponent, YComponent, ZComponent
bnd_5 = Bounds(Numbers=flatten(pdecon_3.ZComponent))
dedomain_3 = DeconstructDomain(Domain=bnd_5)  # -> Start, End
gradient_3 = Gradient(
    LowerLimit=dedomain_3.Start,
    UpperLimit=dedomain_3.End,
    Parameter=flatten(pdecon_3.ZComponent),
    stops=[0: RGB(234, 38, 0), 0.177: RGB(234, 126, 0), 0.332: RGB(254, 244, 84), 0.871: RGB(173, 203, 249), 1: RGB(75, 107, 169)])
preview_3 = CustomPreview(Geometry=flatten(contour_3), Material=gradient_3)
createatts_3 = CreateAttributes(LayerName="Contours", Color=gradient_3, enableFullPath=False)
bake_4 = BakeGeometry(Bake=Button(), Geometry=flatten(contour_3), Attributes=createatts_3, DeleteOldBakes=False, PreserveTrees=False)

# ==== cluster Cluster
