# Grasshopper definition route.gh (Grasshopper 1.0.8)
# plug-ins: Human, Heron, eleFront5

# Reading textfiles (with Grasshopper)
cluster = Cluster()
path = FilePath("C:\Users\53063\Downloads\camden_lat_lon_polarity.csv")
file = ReadFile(File=path, PerLineParse=True)
panel = Panel(file)
cull_i = CullIndex(List=file, Indices="0", Wrap=True)
tab = Panel(",")
split = TextSplit(Text=cull_i, Separators=tab)
panel_2 = Panel(split)
item = ListItem(List=split, Index="3", Wrap=True)  # -> Item, Item1, Item2, Item3, Item4, Item5
panel_3 = Panel(item.Item2)
flatten_tree = FlattenTree(Tree=item.Item, Path="{0}")
flatten_tree_2 = FlattenTree(Tree=item.Item1, Path="{0}")
decimal_degrees_to_xy = DecimalDegreesToXY(Latitude=flatten_tree, Longitude=flatten_tree_2)  # -> XyPoint, Transform
geo = Geometry(<curve referenced from the Rhino model>)

# ----
# Bake with attributes (optional)
panel_5 = Panel("5")
item_2 = ListItem(List=split, Index=panel_5, Wrap=True)
tstat = TreeStatistics(Tree=item_2)  # -> Paths, Length, Count
dup = DuplicateData(Data="GSR", Number=tstat.Length, Order=True)  # -> simplify(Data)
ef_att = EleFrontAttributes(Keys=dup, Values=item_2, Layer="Points", maintainBakeName=False)  # -> flatten(Attributes), Keys, Values, Name, Layer, ColourSource, DisplayColour, MaterialSource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
bake = BakeObjects(Geometry=geo, Attributes=ef_att.Attributes, Bake=False, createGroups=False)  # -> Message, Ghosts

panel_6 = Panel(item_2)
panel_7 = Panel(dup)
multiplication = Multiplication(B=Slider(100, range=0..10000))
multiplication_2 = Multiplication(B=Slider(100, range=0..10000))
pt = ConstructPoint(XCoordinate=multiplication_2, YCoordinate=multiplication, ZCoordinate=0)
construct_domain = ConstructDomain(DomainStart=Slider(0, range=0..100), DomainEnd=Slider(860000, range=0..10000000))
panel_8 = Panel(pt)
remap_numbers = RemapNumbers(Value=item.Item2, Source=Domain(0, 1), Target=construct_domain)  # -> flatten(Mapped), Clipped
deconstruct = Deconstruct(Point=decimal_degrees_to_xy.XyPoint)  # -> XComponent, YComponent, ZComponent
pt_2 = ConstructPoint(XCoordinate=deconstruct.XComponent, YCoordinate=deconstruct.YComponent, ZCoordinate=remap_numbers.Mapped)
pt_3 = ConstructPoint(XCoordinate=deconstruct.XComponent, YCoordinate=deconstruct.YComponent, ZCoordinate=0)
panel_9 = Panel(pt_2)
line = Line(StartPoint=pt_2, EndPoint=pt_3)

# ----
# Field values of OSM are here:
# https://wiki.openstreetmap.org/wiki/Map_features
# you can test example values here:
# https://www.openstreetmap.org/node/6429327326
# 
# The format is
# [Key],[Value]
filterfiields = Panel("natural")
path_2 = FilePath("D:\1group D\tearm2\field.trip\data\GH\map (2).osm")
# 真实地理
geo_2 = Geometry(<curve referenced from the Rhino model>)
panel_10 = Panel("addr:postcode,SE1 7ND")
panel_11 = Panel("amenity,cafe")
filterfieldvalue = Panel("natural,tree")
importosm = ImportOSM(Boundary=geo_2, OSMDataLocation=path_2, Clipped=True)  # -> Extents, Fields, Values, FeatureGeometry, Buildings

# ----
# 数值热力（不会做版
pt_4 = Point([<point referenced from the Rhino model> x5000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])
del = DelaunayMesh(Points=pt_4, Plane=PlaneXY(0, 0, 0))
contour = Contour(Shape=del, Point=Point(0, 0, 0), Direction=Vector(0, 0, 1), Distance=Slider(100, range=0..100))
number_slider = Slider(3, range=0..10)
join = JoinCurves(Curves=contour, Preserve=Slider(80, range=0..100))
eval = EvaluateCurve(Curve=join, Parameter=0)  # -> Point, Tangent, Angle
pdecon = Deconstruct(Point=eval.Point)  # -> XComponent, YComponent, ZComponent
bnd = Bounds(Numbers=flatten(pdecon.ZComponent))
dedomain = DeconstructDomain(Domain=bnd)  # -> Start, End
gradient = Gradient(
    LowerLimit=dedomain.Start,
    UpperLimit=dedomain.End,
    Parameter=flatten(pdecon.ZComponent),
    stops=[0: RGB(65, 68, 67), 0: RGB(105, 223, 228), 0: RGB(188, 178, 127), 0: RGB(234, 38, 0), 0: RGB(69, 52, 158), 0: RGB(250, 45, 234), 0: RGB(138, 115, 221), 0: RGB(31, 59, 86), 0: RGB(49, 43, 55), 0: RGB(197, 33, 239)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])
preview = CustomPreview(Geometry=flatten(contour), Material=gradient)
createatts = CreateAttributes(LayerName="Contours", Color=gradient, enableFullPath=False)
bake_2 = BakeGeometry(Bake=Button(), Geometry=flatten(contour), Attributes=createatts, DeleteOldBakes=False, PreserveTrees=False)

# ---- group: Input
geo_3 = Geometry([<point referenced from the Rhino model> x100])
y = Panel("30")
x = Panel("50")

# ----
filterfieldvalue_2 = Panel("[Key],[Value]")

# ---- group: Inclusion
sqgrid = Square(Plane=PlaneXY(0, 0, 0), Size=1, ExtentX=x, ExtentY=y)  # -> flatten(Cells), Points
area = Area(Geometry=sqgrid.Cells)  # -> Area, Centroid
merge = Merge(Data1=geo_3, Data2=area.Centroid)
pt_5 = Point(merge)
incurves = PointInCurves(Point=pt_5, Curves=sqgrid.Cells)  # -> Relationship, Index, Point

# ----
panel_12 = Panel(merge)

# ---- group: Check one cell
equals = Equality(FirstNumber=incurves.Index, SecondNumber="12")  # -> Equality, Inequality
cull = CullPattern(List=pt_5, CullPattern=equals.Equality)
panel_13 = Panel(cull)

# ---- group: Check all cells
multiplication_3 = Multiplication(A=x, B=y)
series = Series(Start=0, Step=1, Count=multiplication_3)  # -> simplify(graft(Series))
equals_2 = Equality(FirstNumber=incurves.Index, SecondNumber=series)  # -> Equality, Inequality
cull_2 = CullPattern(List=pt_5, CullPattern=equals_2.Equality)
panel_14 = Panel(cull_2)

# ----
# SPATIAL BINNING IN GRASSHOPPER
# How do you read the result?
# 
# The first line isn0 | 21
# and that means that Point 0 is in
# curve 21
# 
# Same is true for
# 1 | 21
# 
# And the third line is 2 | 12
# and that means that point 2
# is in curve 12.
# Add contrast by "streching" the numbers
panel_15 = Panel(pt_5)
panel_16 = Panel(incurves.Index)
tstat_2 = TreeStatistics(Tree=cull_2)  # -> Paths, Length, Count

# ---- group: Surface Grid
bnd_2 = Bounds(Numbers=flatten(tstat_2.Length))
dom = ConstructDomain(DomainStart="0", DomainEnd="16")
remap = RemapNumbers(Value=tstat_2.Length, Source=bnd_2, Target=dom)  # -> Mapped, Clipped
Z = UnitZ(Factor=remap.Mapped)
move = Move(Geometry=area.Centroid, Motion=Z)  # -> Geometry, Transform
srfgrid = SurfaceFromPoints(Points=move.Geometry, UCount=x, Interpolate=False)

# ---- group: Graphics & Baking
contour_2 = Contour(Shape=srfgrid, Point=Point(0, 0, 0), Direction=Vector(0, 0, 1), Distance=Slider(0.117, range=0..1))
eval_2 = EvaluateCurve(Curve=contour_2, Parameter=0)  # -> Point, Tangent, Angle
pdecon_2 = Deconstruct(Point=eval_2.Point)  # -> XComponent, YComponent, ZComponent
bnd_3 = Bounds(Numbers=flatten(pdecon_2.ZComponent))
dedomain_2 = DeconstructDomain(Domain=bnd_3)  # -> Start, End
gradient_2 = Gradient(
    LowerLimit=dedomain_2.Start,
    UpperLimit=dedomain_2.End,
    Parameter=flatten(pdecon_2.ZComponent),
    stops=[0: RGB(234, 38, 0), 0.177: RGB(234, 126, 0), 0.332: RGB(254, 244, 84), 0.871: RGB(173, 203, 249), 1: RGB(75, 107, 169)])
preview_2 = CustomPreview(Geometry=flatten(contour_2), Material=gradient_2)
createatts_2 = CreateAttributes(LayerName="Contours", Color=gradient_2, enableFullPath=False)
bake_3 = BakeGeometry(Bake=Button(), Geometry=flatten(contour_2), Attributes=createatts_2, DeleteOldBakes=False, PreserveTrees=False)

# ==== cluster Cluster
